# Grasshopper definition Stepping facade from curve.gh (Grasshopper 1.0.8)
# plug-ins: Pufferfish

curve = Curve([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])
curve_2 = Curve([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])
graft_tree = GraftTree(Tree=curve_2, IncludeEmptyLists=True, IncludeNullItems=True)
graft_tree_2 = GraftTree(Tree=curve, IncludeEmptyLists=True, IncludeNullItems=True)
step_size = Slider(2, range=0..10)  # disabled
explode = Explode(Curve=graft_tree, Recursive=True)  # -> graft(Segments), Vertices
explode_2 = Explode(Curve=graft_tree_2, Recursive=True)  # -> graft(Segments), Vertices

# ---- group: Setting out on plan
# Inputs
crv = Curve(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)  # disabled

# ---- group: upper limit on elevation
crv_2 = Curve(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)  # disabled

# ---- group: grid setting out
# line with a direction, start point is origin
crv_3 = Curve(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)  # disabled

# ---- group: lower limit on elevation
# limits are drawn on elevation view
crv_4 = Curve(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)  # disabled

# ----
step_size_2 = GetNumber(step_size, AtLeast=1, AtMost=1, Maximum=1.797693135e+308, Minimum=-1.797693135e+308, TreeAccess=False)  # disabled
panel_width = GetNumber(Slider(1.5, range=0.5..5), AtLeast=1, AtMost=1, Maximum=1.797693135e+308, Minimum=-1.797693135e+308, TreeAccess=False)
step_max_depth = GetNumber(Slider(1, range=0..2), AtLeast=1, AtMost=1, Maximum=1.797693135e+308, Minimum=-1.797693135e+308, TreeAccess=False)
curve_degree = CurveDegree(Curve=explode.Segments)
curve_degree_2 = CurveDegree(Curve=explode_2.Segments)
crv_5 = Curve(graft(crv))  # disabled
num = Number(step_size_2)  # disabled
crv_6 = Curve(graft(crv_4))  # disabled
crv_7 = Curve(graft(crv_3))  # disabled
crv_8 = Curve(graft(crv_2))  # disabled
end = EndPoints(Curve=crv_7)  # -> Start, End; disabled
Z = UnitZ(Factor=1)  # disabled
larger_than = LargerThan(FirstNumber=curve_degree, SecondNumber=Slider(1, range=0..1))  # -> LargerThan, OrEqualTo
larger_than_2 = LargerThan(FirstNumber=curve_degree_2, SecondNumber=Slider(1, range=0..1))  # -> LargerThan, OrEqualTo
merge = Merge(Data1=crv_8, Data2=crv_6)  # disabled
end_2 = EndPoints(Curve=crv_5)  # -> Start, End; disabled
pl = ConstructPlane(Origin=end.Start, XAxis=crv_7, YAxis=Vector(0, 1, 0))  # disabled
pl_2 = ConstructPlane(Origin=end.Start, XAxis=crv_7, YAxis=Z)  # disabled
plcoord = PlaneCoordinates(Point=end_2.End, System=pl)  # -> XCoordinate, YCoordinate, ZCoordinate; disabled
division = Division(A=plcoord.XCoordinate, B=num)  # disabled
cull_pattern = CullPattern(List=explode.Segments, CullPattern=invert(larger_than.LargerThan))
cull_pattern_2 = CullPattern(List=explode_2.Segments, CullPattern=invert(larger_than_2.LargerThan))
expression = Expression(x=division, Expression="Floor(x)")  # disabled
series = Series(Start=0, Step=num, Count=expression)  # disabled
length = Length(Curve=cull_pattern)
length_2 = Length(Curve=cull_pattern_2)
cull_pattern_3 = CullPattern(List=explode.Segments, CullPattern=larger_than.LargerThan)
rotate = Rotate(Geometry=crv_7, Angle=1.570796327, Plane=end.Start)  # -> Geometry, Transform; disabled
amp = Amplitude(Vector=crv_7, Amplitude=series)  # disabled
cull_pattern_4 = CullPattern(List=explode_2.Segments, CullPattern=larger_than_2.LargerThan)
division_2 = Division(A=length, B=panel_width)
division_3 = Division(A=length_2, B=panel_width)
move = Move(Geometry=rotate.Geometry, Motion=amp)  # -> Geometry, Transform; disabled
round = Round(Number=division_2)  # -> Nearest, Floor, Ceiling
clx = CurveLine(Curve=crv_5, Line=move.Geometry)  # -> Points, Params, Count; disabled
round_2 = Round(Number=division_3)  # -> Nearest, Floor, Ceiling
pshift = ShiftPaths(Data=clx.Points, Offset=-1)  # disabled
length_3 = Length(Curve=cull_pattern_3)
length_4 = Length(Curve=cull_pattern_4)
cull_i = CullIndex(List=reverse(pshift), Indices=0, Wrap=True)  # -> reverse(List); disabled
cull_i_2 = CullIndex(List=pshift, Indices=0, Wrap=True)  # disabled
pln = Plane(pl)  # disabled
divide_curve = DivideCurve(Curve=cull_pattern, Count=round.Ceiling, Kinks=False)  # -> Points, Tangents, Parameters
list_length = ListLength(List=divide_curve.Points)
divide_curve_2 = DivideCurve(Curve=cull_pattern_2, Count=round_2.Ceiling, Kinks=False)  # -> Points, Tangents, Parameters
list_length_2 = ListLength(List=divide_curve_2.Points)
division_4 = Division(A=length_3, B=panel_width)
division_5 = Division(A=length_4, B=panel_width)
plcoord_2 = PlaneCoordinates(Point=cull_i_2, System=pln)  # -> XCoordinate, YCoordinate, ZCoordinate; disabled
plcoord_3 = PlaneCoordinates(Point=cull_i, System=pln)  # -> XCoordinate, YCoordinate, ZCoordinate; disabled
range = Range(Domain=Domain(0, 1), Steps=expr("x-1", list_length))
range_2 = Range(Domain=Domain(0, 1), Steps=expr("x-1", list_length_2))
round_3 = Round(Number=division_4)  # -> Nearest, Floor, Ceiling
round_4 = Round(Number=division_5)  # -> Nearest, Floor, Ceiling
curve_closest_point = CurveClosestPoint(Point=divide_curve.Points, Curve=cull_pattern)  # -> Point, Parameter, Distance
curve_closest_point_2 = CurveClosestPoint(Point=divide_curve_2.Points, Curve=cull_pattern_2)  # -> Point, Parameter, Distance

# ---- group: Inside/outside
toggle = BooleanToggle(True)  # disabled

# ----
pt = PointOriented(BasePlane=pln, UComponent=plcoord_3.XCoordinate, VComponent=plcoord_2.YCoordinate, WComponent=0)  # disabled
pt_2 = PointOriented(BasePlane=pln, UComponent=plcoord_2.XCoordinate, VComponent=plcoord_3.YCoordinate, WComponent=0)  # disabled
perp_frame = PerpFrame(Curve=cull_pattern, Parameter=curve_closest_point.Parameter)
graph_mapper = GraphMapper(range, x0=0, x1=1, y0=0, y1=1, container_name="Sine", Equation_px=[0.01320594456, 0.5028626323], Equation_py=[0, 1])
perp_frame_2 = PerpFrame(Curve=cull_pattern_2, Parameter=curve_closest_point_2.Parameter)
graph_mapper_2 = GraphMapper(range_2, x0=0, x1=1, y0=0, y1=1, container_name="Sine", Equation_px=[0, 0.249140352], Equation_py=[0, 0.9946306944])
divide_curve_3 = DivideCurve(Curve=cull_pattern_3, Count=round_3.Ceiling, Kinks=False)  # -> Points, Tangents, Parameters
divide_curve_4 = DivideCurve(Curve=cull_pattern_4, Count=round_4.Ceiling, Kinks=False)  # -> Points, Tangents, Parameters
merge_2 = Merge(Data1=graft(pt), Data2=graft(pt_2))  # disabled
bool = Boolean(toggle)  # disabled

# ---- group: mullion dim
number_slider = Slider(0.08, range=0..0.1)  # disabled

# ----
deconstruct_plane = DeconstructPlane(Plane=perp_frame)  # -> Origin, XAxis, YAxis, ZAxis
deconstruct_plane_2 = DeconstructPlane(Plane=perp_frame_2)  # -> Origin, XAxis, YAxis, ZAxis
item = ListItem(List=merge_2, Index=bool, Wrap=True)  # disabled

# ---- group: Flip side of mullions
# Parameters
toggle_2 = BooleanToggle(True)  # disabled

# ----
shift_list = ShiftList(List=divide_curve.Points, Shift=1, Wrap=True)
pln_2 = Plane(pl_2)  # disabled
shift_list_2 = ShiftList(List=divide_curve_2.Points, Shift=1, Wrap=True)
pshift_2 = ShiftPaths(Data=item, Offset=-1)  # disabled
project = Project(Geometry=merge, Plane=pln_2)  # -> Geometry, Transform; disabled
curve_closest_point_3 = CurveClosestPoint(Point=divide_curve_3.Points, Curve=cull_pattern_3)  # -> Point, Parameter, Distance
curve_closest_point_4 = CurveClosestPoint(Point=divide_curve_4.Points, Curve=cull_pattern_4)  # -> Point, Parameter, Distance
construct_domain = ConstructDomain(DomainStart=0, DomainEnd=step_max_depth)
construct_domain_2 = ConstructDomain(DomainStart=0, DomainEnd=step_max_depth)
expression_2 = Expression(x=number_slider, Expression="3/4/2*x")  # disabled
weave = Weave(Pattern=[0, 1], Stream0=pshift, Stream1=pshift_2, NullGaps=False)  # disabled
bounds = Bounds(Numbers=graph_mapper)
perp_frame_3 = PerpFrame(Curve=cull_pattern_3, Parameter=curve_closest_point_3.Parameter)
bounds_2 = Bounds(Numbers=graph_mapper_2)
number_slider_2 = Slider(8, range=0..10)  # disabled
perp_frame_4 = PerpFrame(Curve=cull_pattern_4, Parameter=curve_closest_point_4.Parameter)
pt_3 = Point(weave)  # disabled
plcoord_4 = PlaneCoordinates(Point=pt_3, System=pln)  # -> XCoordinate, YCoordinate, ZCoordinate; disabled
sort = SortList(Keys=plcoord_4.YCoordinate)  # -> Keys, ValuesA; disabled
item_2 = ListItem(List=reverse(sort.Keys), Index=0, Wrap=True)  # disabled
item_3 = ListItem(List=sort.Keys, Index=0, Wrap=True)  # disabled
subtraction = Subtraction(A=item_2, B=item_3)  # disabled
neg = Negative(Value=expression_2)  # disabled
deconstruct_plane_3 = DeconstructPlane(Plane=perp_frame_3)  # -> Origin, XAxis, YAxis, ZAxis
merge_3 = Merge(Data1=expression_2, Data2=neg)  # disabled
bool_2 = Boolean(toggle_2)  # disabled
deconstruct_plane_4 = DeconstructPlane(Plane=perp_frame_4)  # -> Origin, XAxis, YAxis, ZAxis

# ---- group: polyline on plan
pline = PolyLine(Vertices=pt_3, Closed=False)  # disabled

# ----
division_6 = Division(A=number_slider, B=number_slider_2)  # disabled
remap_numbers = RemapNumbers(Value=graph_mapper, Source=bounds, Target=construct_domain)  # -> Mapped, Clipped
amplitude = Amplitude(Vector=deconstruct_plane_4.XAxis, Amplitude=Slider(0.1, range=0..1))
crv_9 = Curve(pline)  # disabled
remap_numbers_2 = RemapNumbers(Value=graph_mapper_2, Source=bounds_2, Target=construct_domain_2)  # -> Mapped, Clipped
deplane = DeconstructPlane(Plane=pln)  # -> Origin, XAxis, YAxis, ZAxis; disabled
item_4 = ListItem(List=merge_3, Index=bool_2, Wrap=True)  # disabled
amplitude_2 = Amplitude(Vector=deconstruct_plane.YAxis, Amplitude=remap_numbers.Mapped)
amplitude_3 = Amplitude(Vector=deconstruct_plane_2.YAxis, Amplitude=remap_numbers_2.Mapped)
amp_2 = Amplitude(Vector=deplane.YAxis, Amplitude=item_3)  # disabled
explode_3 = Explode(Curve=crv_9, Recursive=True)  # -> Segments, Vertices; disabled
offset_l = OffsetCurveLoose(Curve=pline, Distance=item_4)  # disabled
amplitude_4 = Amplitude(Vector=deconstruct_plane_3.XAxis, Amplitude=Slider(0.3, range=0..1))
move_2 = Move(Geometry=divide_curve_3.Points, Motion=amplitude_4)  # -> Geometry, Transform
amplitude_5 = Amplitude(Vector=deconstruct_plane_4.XAxis, Amplitude=Slider(0.2, range=0..1))
move_3 = Move(Geometry=divide_curve_4.Points, Motion=amplitude_5)  # -> Geometry, Transform
end_3 = EndPoints(Curve=explode_3.Segments)  # -> Start, End; disabled
explode_4 = Explode(Curve=offset_l, Recursive=True)  # -> Segments, Vertices; disabled
reverse = Reverse(Vector=amplitude_2)
move_4 = Move(Geometry=shift_list, Motion=reverse)  # -> Geometry, Transform
move_5 = Move(Geometry=divide_curve.Points, Motion=reverse)  # -> Geometry, Transform
cull_index = CullIndex(List=move_4.Geometry, Indices=-1, Wrap=True)
move_6 = Move(Geometry=project.Geometry, Motion=amp_2)  # -> Geometry, Transform; disabled
reverse_2 = Reverse(Vector=amplitude_3)
move_7 = Move(Geometry=shift_list_2, Motion=reverse_2)  # -> Geometry, Transform
move_8 = Move(Geometry=divide_curve_2.Points, Motion=reverse_2)  # -> Geometry, Transform
cull_index_2 = CullIndex(List=move_7.Geometry, Indices=-1, Wrap=True)
move_9 = Move(Geometry=divide_curve_4.Points, Motion=amplitude)  # -> Geometry, Transform
amp_3 = Amplitude(Vector=deplane.YAxis, Amplitude=subtraction)  # disabled
vec2pt = Vector2Pt(PointA=end_3.Start, PointB=end_3.End, Unitize=False)  # -> Vector, Length; disabled
line = LineSDL(Start=explode_4.Vertices, Direction=Vector(0, 0, 1), Length=1)  # disabled
line_2 = LineSDL(Start=pt_3, Direction=Vector(0, 0, 1), Length=1)  # disabled
line_3 = Line(StartPoint=divide_curve_3.Points, EndPoint=move_2.Geometry)
line_4 = Line(StartPoint=move_9.Geometry, EndPoint=move_3.Geometry)
neg_2 = Negative(Value=vec2pt.Vector)  # disabled
extr = Extrude(Base=move_6.Geometry, Direction=amp_3)  # disabled
weave_2 = Weave(Pattern=[0, 1], Stream0=move_5.Geometry, Stream1=cull_index, NullGaps=False)
weave_3 = Weave(Pattern=[0, 1], Stream0=move_8.Geometry, Stream1=cull_index_2, NullGaps=False)
line_5 = LineSDL(Start=end_3.Start, Direction=vec2pt.Vector, Length=number_slider)  # disabled
line_6 = LineSDL(Start=end_3.End, Direction=neg_2, Length=number_slider)  # disabled
polyline = PolyLine(Vertices=move_2.Geometry, Closed=False)
slx = SurfaceLine(Surface=extr, Line=graft(line), LimitToFirst=False)  # -> Curves, Points, UVPoints, Normal; disabled
polyline_2 = PolyLine(Vertices=weave_2, Closed=False)
neg_3 = Negative(Value=division_6)  # disabled
slx_2 = SurfaceLine(Surface=extr, Line=graft(line_2), LimitToFirst=False)  # -> Curves, Points, UVPoints, Normal; disabled
join = JoinCurves(Curves=[line_5, line_6], Preserve=False)  # -> graft(Curves); disabled
polyline_3 = PolyLine(Vertices=weave_3, Closed=False)
pshift_3 = ShiftPaths(Data=slx.Points, Offset=-1)  # disabled
polyline_4 = PolyLine(Vertices=move_3.Geometry, Closed=False)
pshift_4 = ShiftPaths(Data=slx_2.Points, Offset=-1)  # disabled
pshift_5 = ShiftPaths(Data=pshift_4, Offset=-1)  # disabled
offset = OffsetCurve(Curve=join, Distance=neg_3, Corners=1)  # disabled
offset_2 = OffsetCurve(Curve=join, Distance=division_6, Corners=1)  # disabled
pdecon = Deconstruct(Point=pshift_5)  # -> XComponent, YComponent, ZComponent; disabled
explode_5 = Explode(Curve=polyline_2, Recursive=True)  # -> Segments, Vertices
explode_6 = Explode(Curve=polyline_3, Recursive=True)  # -> Segments, Vertices
pline_2 = PolyLine(Vertices=pshift_3, Closed=False)  # disabled
pline_3 = PolyLine(Vertices=pshift_4, Closed=False)  # disabled
sort_2 = SortList(Keys=pdecon.ZComponent)  # -> Keys, ValuesA; disabled
end_4 = EndPoints(Curve=offset_2)  # -> Start, End; disabled
end_5 = EndPoints(Curve=offset)  # -> Start, End; disabled
number_slider_3 = Slider(0.05, range=0..0.1)
number_slider_4 = Slider(0.05, range=0..0.1)
explode_7 = Explode(Curve=polyline, Recursive=True)  # -> Segments, Vertices
end_6 = EndPoints(Curve=pline_2)  # -> Start, End; disabled
pshift_6 = ShiftPaths(Data=pline_3, Offset=-1)  # disabled
explode_8 = Explode(Curve=polyline_4, Recursive=True)  # -> Segments, Vertices
vec = Vector(crv_7)  # disabled
item_5 = ListItem(List=reverse(sort_2.Keys), Index=0, Wrap=True)  # disabled
number_slider_5 = Slider(0, range=0..1)
item_6 = ListItem(List=sort_2.Keys, Index=0, Wrap=True)  # disabled
number_slider_6 = Slider(0.1, range=0..1)
ln = Line(StartPoint=end_4.Start, EndPoint=end_5.Start)  # disabled
ln_2 = Line(StartPoint=end_4.End, EndPoint=end_5.End)  # disabled
curve_3 = Curve(graft(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))
dom = ConstructDomain(DomainStart=expr("-x/2", number_slider), DomainEnd=expr("x/2", number_slider))  # disabled
loft = Loft(Curves=pshift_6, Options={Adjust=False, Closed=False, LoftEnds=0, LoftSimp=0, LoftType=3, Rebuild=10, Refit=0.01})  # disabled
expression_3 = Expression(x=item_6, Expression="x-1")  # disabled
pl_3 = ConstructPlane(Origin=end_6.Start, XAxis=vec, YAxis=Vector(0, 1, 0))  # disabled
vec2pt_2 = Vector2Pt(PointA=end_6.Start, PointB=end_6.End, Unitize=False)  # -> Vector, Length; disabled
subtraction_2 = Subtraction(A=item_5, B=item_6)  # disabled
curve_4 = Curve(graft([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]))
merge_4 = Merge(Data1=offset_2, Data2=ln, Data3=offset, Data4=ln_2)  # disabled
negative = Negative(Value=number_slider_3)
expression_4 = Expression(x=subtraction_2, Expression="x+2")  # disabled
negative_2 = Negative(Value=number_slider_4)
rectangle = Rectangle(Plane=pl_3, XSize=dom, YSize=dom, Radius=0)  # -> Rectangle, Length; disabled
length_5 = Length(Curve=curve_4)
extend_curve = ExtendCurve(Curve=line_3, Type=0, Start=number_slider_5, End=number_slider_5)
length_6 = Length(Curve=curve_3)
extend_curve_2 = ExtendCurve(Curve=line_4, Type=0, Start=number_slider_6, End=number_slider_6)
join_2 = JoinCurves(Curves=merge_4, Preserve=False)  # disabled
trim_tree = TrimTree(Tree=simplify(explode_7.Segments), Depth=1)
Z_2 = UnitZ(Factor=expression_3)  # disabled
Z_3 = UnitZ(Factor=expression_4)  # disabled
trim_tree_2 = TrimTree(Tree=simplify(extend_curve), Depth=1)
dispatch = Dispatch(List=explode_5.Segments, DispatchPattern=[True, False])  # -> ListA, ListB
unit_z = UnitZ(Factor=length_5)
dispatch_2 = Dispatch(List=explode_6.Segments, DispatchPattern=[True, False])  # -> ListA, ListB
unit_z_2 = UnitZ(Factor=length_6)
offset_curve = OffsetCurve(Curve=extend_curve_2, Plane=PlaneXY(0, 0, 0), Distance=number_slider_4, BothSides=negative_2, Kinks=0, CapType=1)
move_10 = Move(Geometry=join_2, Motion=Z_2)  # -> Geometry, Transform; disabled
extr_2 = Extrude(Base=move_10.Geometry, Direction=Z_3)  # disabled
offset_curve_2 = OffsetCurve(Curve=trim_tree_2, Plane=PlaneXY(0, 0, 0), Distance=number_slider_3, BothSides=negative, Kinks=0, CapType=1)
curve_5 = Curve(dispatch.ListB)
curve_6 = Curve(dispatch.ListA)
curve_7 = Curve(dispatch_2.ListB)
curve_8 = Curve(dispatch_2.ListA)
pshift_7 = ShiftPaths(Data=extr_2, Offset=-2)  # disabled
number_slider_7 = Slider(0.05, range=0..0.1)
number_slider_8 = Slider(0.05, range=0..0.1)
trim_tree_3 = TrimTree(Tree=simplify(curve_6), Depth=1)
number_slider_9 = Slider(0.2, range=0..1)
bbx = BrepBrep(BrepA=pshift_7, BrepB=extr)  # -> Curves, Points; disabled
trim_tree_4 = TrimTree(Tree=simplify(offset_curve_2), Depth=1)
number_slider_10 = Slider(0.2, range=0..1)
trim_tree_5 = TrimTree(Tree=simplify(curve_5), Depth=1)
# Bake
pshift_8 = ShiftPaths(Data=bbx.Curves, Offset=-1)  # disabled
negative_3 = Negative(Value=number_slider_7)
negative_4 = Negative(Value=number_slider_8)

# ---- group: mullions
extr_3 = Extrude(Base=rectangle.Rectangle, Direction=vec2pt_2.Vector)  # disabled

# ---- group: mullion cap
loft_2 = Loft(Curves=pshift_8, Options={Adjust=False, Closed=False, LoftEnds=0, LoftSimp=0, LoftType=3, Rebuild=10, Refit=0.01})  # disabled

# ---- group: glass
brep = Brep(loft)  # disabled

# ----
extend_curve_3 = ExtendCurve(Curve=trim_tree_5, Type=0, Start=number_slider_9, End=number_slider_9)
extend_curve_4 = ExtendCurve(Curve=curve_7, Type=0, Start=number_slider_10, End=number_slider_10)
extrude = Extrude(Base=trim_tree, Direction=unit_z)
deconstruct_brep = DeconstructBrep(Brep=brep)  # -> Faces, Edges, Vertices; disabled
offset_curve_3 = OffsetCurve(Curve=extend_curve_4, Plane=PlaneXY(0, 0, 0), Distance=number_slider_8, BothSides=negative_4, Kinks=0, CapType=1)
offset_curve_4 = OffsetCurve(Curve=extend_curve_3, Plane=PlaneXY(0, 0, 0), Distance=number_slider_7, BothSides=negative_3, Kinks=0, CapType=1)
extrude_2 = Extrude(Base=trim_tree_4, Direction=unit_z)
mesh = Mesh([loft_2, extr_3, brep])  # disabled
extrude_3 = Extrude(Base=trim_tree_3, Direction=unit_z)
extrude_4 = Extrude(Base=explode_8.Segments, Direction=unit_z_2)  # -> simplify(Extrusion)
list_length_3 = ListLength(List=deconstruct_brep.Faces)  # disabled
extrude_5 = Extrude(Base=curve_8, Direction=unit_z_2)
extrude_6 = Extrude(Base=offset_curve, Direction=unit_z_2)
trim_tree_6 = TrimTree(Tree=simplify(offset_curve_4), Depth=1)
extrude_7 = Extrude(Base=trim_tree_6, Direction=unit_z)
extrude_8 = Extrude(Base=offset_curve_3, Direction=unit_z_2)
context_bake = ContextBake(Content=mesh)  # disabled
panel = Panel("This model containts ")  # disabled
panel_2 = Panel(" panels.")  # disabled
concatenate = Concatenate(Fragment_A=panel, Fragment_B=list_length_3, A=panel_2)  # disabled
brep_2 = Brep(simplify([extrude_4, extrude, extrude_3, extrude_5]))
context_print = ContextPrint(Text=concatenate)  # disabled
clean_tree = CleanTree(RemoveNulls=True, RemoveInvalid=True, RemoveEmpty=False, Tree=brep_2)
md_slider = MDSlider(SliderMode=0, slider_value=Point(0.5, 0.5, 0.5), x_domain=Domain(0, 1), y_domain=Domain(0, 1), z_domain=Domain(0, 1))
flatten_tree = FlattenTree(Tree=clean_tree, Path="{0}")  # -> graft(Tree)
evaluate_surface = EvaluateSurface(Surface=reparameterize(flatten_tree), Point=md_slider)  # -> Point, Normal, UDirection, VDirection, Frame
brep_3 = Brep([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])
mesh_2 = Mesh(brep_3)
xy_plane = XYPlane(Origin=evaluate_surface.Point)
context_bake_2 = ContextBake(Content=mesh_2)
brep_plane = BrepPlane(Brep=flatten_tree, Plane=xy_plane)  # -> simplify(Curves), Points
surface_split = SurfaceSplit(Surface=simplify(flatten_tree), Curves=brep_plane.Curves)
md_slider_2 = MDSlider(SliderMode=0, slider_value=Point(0.5, 0.5, 0.5), x_domain=Domain(0, 1), y_domain=Domain(0, 1), z_domain=Domain(0, 1))
deconstruct_brep_2 = DeconstructBrep(Brep=surface_split)  # -> Faces, Edges, Vertices
evaluate_surface_2 = EvaluateSurface(Surface=reparameterize(surface_split), Point=md_slider_2)  # -> Point, Normal, UDirection, VDirection, Frame
join_curves = JoinCurves(Curves=deconstruct_brep_2.Edges, Preserve=False)  # -> graft(Curves)
negative_5 = Negative(Value=Slider(0.05, range=0..0.1))
offset_curve_5 = OffsetCurve(Curve=join_curves, Distance=negative_5, Plane=graft(evaluate_surface_2.Frame), Corners=1)
merge_5 = Merge(Data1=simplify(join_curves), Data2=simplify(offset_curve_5))
boundary_surfaces = BoundarySurfaces(Edges=merge_5)
python_3_script = Python3Script(
    panels=flatten(surface_split),
    frames=flatten([extrude_6, extrude_8, extrude_2, extrude_7, boundary_surfaces]),
    to_mm=Slider(1000, range=0..1000))  # -> out, a, info; inputs panels: list of Brep, frames: list of Brep, to_mm: Double
# ---------- python_3_script: Python ----------
"""
Inputs:
    panels: Brep, List Access  - one item per glass pane
    frames: Brep, List Access  - frame geometry, passed through without panel data
    to_mm:  float, Item Access - model units to mm (1 if the model is in mm, 1000 if in metres)
Outputs:
    a:    meshes for Context Bake
    info: one line per panel, for checking in a Panel component
"""
import Rhino.Geometry as rg


def mesh_of(brep):
    """Turns a Brep into a single mesh."""
    mesh = rg.Mesh()
    for part in rg.Mesh.CreateFromBrep(brep, rg.MeshingParameters.FastRenderMesh) or []:
        mesh.Append(part)
    return mesh


def size_of(brep):
    """Width (horizontal) and height (vertical) of a pane, measured in the pane's own plane."""
    face = brep.Faces[0]
    ok, face_frame = face.FrameAt(face.Domain(0).Mid, face.Domain(1).Mid)
    normal = face_frame.ZAxis

    across = rg.Vector3d.CrossProduct(rg.Vector3d.ZAxis, normal)  # horizontal, along the pane
    if across.IsTiny():  # pane lies flat, like a roof: fall back to the surface's own direction
        across = face_frame.XAxis
    across.Unitize()
    up = rg.Vector3d.CrossProduct(normal, across)
    up.Unitize()

    box = brep.GetBoundingBox(rg.Plane(face_frame.Origin, across, up))  # box measured in that plane
    return box.Max.X - box.Min.X, box.Max.Y - box.Min.Y


scale = to_mm if to_mm else 1.0
a = []
info = []

for i, brep in enumerate(panels or []):
    if brep is None:
        continue
    width, height = size_of(brep)
    width_mm, height_mm = round(width * scale), round(height * scale)
    area_m2 = (width_mm / 1000.0) * (height_mm / 1000.0)
    mass_kg = area_m2 * (4 / 1000.0) * 2500 * 2

    mesh = mesh_of(brep)
    mesh.SetUserString("part", "panel")
    mesh.SetUserString("panel_id", str(i))
    mesh.SetUserString("material", "glass")
    mesh.SetUserString("width", str(width_mm))
    mesh.SetUserString("height", str(height_mm))
    mesh.SetUserString("mass", str(round(mass_kg, 1)))
    a.append(mesh)
    info.append("panel {}: {} x {} mm ({} faces)".format(i, width_mm, height_mm, brep.Faces.Count))

for brep in frames or []:
    if brep is None:
        continue
    mesh = mesh_of(brep)
    mesh.SetUserString("part", "frame")
    mesh.SetUserString("material", "frame")
    a.append(mesh)
# ---------- end python_3_script ----------
context_bake_3 = ContextBake(Content=python_3_script.a)
