# Grasshopper definition Stepping facade on volume.gh (Grasshopper 1.0.8)

number_slider = Slider(2.25, range=0..10)
no_of_levels = Panel("12")
# Input single surface or a single brep open or closed
level_difference = Panel("4")
level_height = GetNumber(number_slider, AtLeast=1, AtMost=1, Maximum=1.797693135e+308, Minimum=-1.797693135e+308, TreeAccess=False)

# ---- group: building volume
# Inputs
brep = Brep(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)

# ---- group: box sticking out - random value
number_slider_2 = Slider(0.3, range=0..5)

# ---- group: width of a panel
width = Slider(2, range=0..10)

# ---- group: box sticking out - every other
number_slider_3 = Slider(0.4, range=0..5)

# ---- group: flip facade
toggle = BooleanToggle(True)

# ----
flip_facade = GetBoolean(toggle, AtLeast=1, AtMost=1, FalseValue="False", TreeAccess=False, TrueValue="True")
protrusion_min = GetNumber(number_slider_2, AtLeast=1, AtMost=1, Maximum=1.797693135e+308, Minimum=-1.797693135e+308, TreeAccess=False)
protrusion_max = GetNumber(number_slider_3, AtLeast=1, AtMost=1, Maximum=1.797693135e+308, Minimum=-1.797693135e+308, TreeAccess=False)
width_2 = GetNumber(width, AtLeast=1, AtMost=1, Maximum=1.797693135e+308, Minimum=-1.797693135e+308, TreeAccess=False)
dom = ConstructDomain(DomainStart="0", DomainEnd=protrusion_min)
domain = Domain(dom)

# ---- group: horizontal mullion dim
number_slider_4 = Slider(0.05, range=0..0.2)

# ---- group: Vertical mullion dim
number_slider_5 = Slider(0.08, range=0..0.1)

# ----
unit_z = UnitZ(Factor=number_slider)

brep_2 = Brep(brep)
bbox = BoundingBox(Content=brep_2, Plane=PlaneXY(0, 0, 0))  # -> Box, Box_2
debrep = DeconstructBrep(Brep=bbox.Box)  # -> Faces, Edges, Vertices
pdecon = Deconstruct(Point=debrep.Vertices)  # -> XComponent, YComponent, ZComponent
sort = SortList(Keys=pdecon.ZComponent)  # -> Keys, ValuesA
item = ListItem(List=reverse(sort.Keys), Index=0, Wrap=True)

division = Division(A=item, B=level_height)
addition = Addition(A=division, B=4)
series = Series(Start=0, Step=level_height, Count=addition)
levels_example = Panel(series)

# ---- group: building levels
num = Number(series)

# ----
larger = LargerThan(FirstNumber=item, SecondNumber=num)  # -> LargerThan, OrEqualTo
cull = CullPattern(List=num, CullPattern=larger.OrEqualTo)
num_2 = Number(cull)
pt = ConstructPoint(XCoordinate=0, YCoordinate=0, ZCoordinate=num_2)
cull_i = CullIndex(List=reverse(pt), Indices=0, Wrap=True)  # -> reverse(List)
reldif = RelativeDifferences(Values=num_2)
xy = XYPlane(Origin=cull_i)
cull_i_2 = CullIndex(List=reldif, Indices=0, Wrap=True)
# Parameters
sec = BrepPlane(Brep=brep_2, Plane=xy)  # -> Curves, Points

crv = Curve(sec.Curves)
graft = GraftTree(Tree=cull_i_2, IncludeEmptyLists=True, IncludeNullItems=True)  # -> simplify(Tree)
explode = Explode(Curve=crv, Recursive=True)  # -> Segments, Vertices
lng = ListLength(List=explode.Segments)
len = Length(Curve=explode.Segments)
division_2 = Division(A=len, B=width_2)
simplify = SimplifyTree(Tree=lng, Front=False)
int = Integer(simplify(division_2))
viewer = ParamViewer(int)
divide = DivideCurve(Curve=simplify(explode.Segments), Count=int, Kinks=False)  # -> Points, Tangents, Parameters
lng_2 = ListLength(List=viewer)
python = GhPythonScript(L=lng_2)  # -> out, a
# ---------- python: Python ----------
# Define the input L as the length of the list
#L = 10

# Create an empty list to store the sequence
sequence = []

# Loop through the range of L
for i in range(L):
  # Use the modulo operator to alternate between 0 and 1
  # Append the result to the sequence list
  sequence.append(i % 2)

# Print the sequence list
a = sequence
# ---------- end python ----------
graft_2 = GraftTree(Tree=python.a, IncludeEmptyLists=True, IncludeNullItems=True)
num_levels_diff = Number(graft)
pline = PolyLine(Vertices=divide.Points, Closed=False)
dup = DuplicateData(Data=graft_2, Number=simplify, Order=True)  # -> graft(Data)
explode_2 = Explode(Curve=pline, Recursive=True)  # -> Segments, Vertices
python_2 = GhPythonScript(input=dup)  # -> out, simplify(a); inputs input: Boolean
# ---------- python_2: Python ----------
# Define the input as a boolean value
#input = True

# Create an empty list to store the output
output = []

# Use an if-else statement to check the input value
if input == False:
  # If the input is False, append 0 and 1 to the output list
  output.append(0)
  output.append(1)
else:
  # If the input is True, append 1 and 0 to the output list
  output.append(1)
  output.append(0)

# Print the output list
a = output
# ---------- end python_2 ----------
pshift = ShiftPaths(Data=explode_2.Segments, Offset=-1)
lng_3 = ListLength(List=pshift)
series_2 = Series(Start=0, Step=0, Count=lng_3)  # -> simplify(Series)
dispatch = Dispatch(List=series_2, DispatchPattern=python_2.a)  # -> ListA, ListB
lng_4 = ListLength(List=dispatch.ListA)
lng_5 = ListLength(List=dispatch.ListB)
random = Random(Range=domain, Number=lng_5, Seed=2)
random_2 = Random(Range=domain, Number=lng_4, Seed=3)
addition_2 = Addition(A=protrusion_max, B=dispatch.ListA)
addition_3 = Addition(A=addition_2, B=random_2)
addition_4 = Addition(B=random)
weave = Weave(Pattern=python_2.a, Stream0=addition_4, Stream1=addition_3, NullGaps=False)  # -> simplify(Weave)
neg = Negative(Value=weave)
rotate = Rotate(Geometry=pshift, Angle=1.570796327, Plane=PlaneXY(0, 0, 0))  # -> Geometry, Transform
merge = Merge(Data1=graft(weave), Data2=graft(neg))
end = EndPoints(Curve=pline)  # -> Start, End
item_2 = ListItem(List=merge, Index=flip_facade, Wrap=True)
pshift_2 = ShiftPaths(Data=item_2, Offset=-1)
amp = Amplitude(Vector=rotate.Geometry, Amplitude=pshift_2)
move = Move(Geometry=pshift, Motion=amp)  # -> Geometry, Transform
explode_3 = Explode(Curve=move.Geometry, Recursive=True)  # -> Segments, Vertices
pshift_3 = ShiftPaths(Data=explode_3.Vertices, Offset=-1)
merge_2 = Merge(Data1=end.Start, Data2=pshift_3, Data3=end.End)

pshift_4 = ShiftPaths(Data=pline, Offset=-1)
join = JoinCurves(Curves=pshift_4, Preserve=False)
Z = UnitZ(Factor=num_levels_diff)
move_2 = Move(Geometry=join, Motion=Z)  # -> Geometry, Transform

pline_2 = PolyLine(Vertices=merge_2, Closed=False)
Z_2 = UnitZ(Factor=num_levels_diff)
pshift_5 = ShiftPaths(Data=pline_2, Offset=-1)

join_2 = JoinCurves(Curves=pshift_5, Preserve=False)
pshift_6 = ShiftPaths(Data=join_2, Offset=-1)

pshift_7 = ShiftPaths(Data=move_2.Geometry, Offset=-1)
crv_2 = Curve(pshift_6)

viewer_2 = ParamViewer(crv_2)
viewer_3 = ParamViewer(pshift_7)
item_3 = ListItem(List=reverse(viewer_3), Index=0, Wrap=True)
item_4 = ListItem(List=viewer_2, Index=0, Wrap=True)
split = SplitTree(Data=pshift_7, Masks=flatten(item_3))  # -> Positive, Negative
split_2 = SplitTree(Data=crv_2, Masks=flatten(item_4))  # -> Positive, Negative
match = MatchTree(Tree=split_2.Negative, Guide=split.Negative)
crv_3 = Curve(split.Negative)
crv_4 = Curve(match)
end_2 = EndPoints(Curve=crv_4)  # -> Start, End
end_3 = EndPoints(Curve=crv_3)  # -> Start, End
dist = Distance(PointA=end_3.Start, PointB=end_2.Start)
dist_2 = Distance(PointA=end_3.Start, PointB=end_2.End)
larger_2 = LargerThan(FirstNumber=dist, SecondNumber=dist_2)  # -> LargerThan, OrEqualTo
dispatch_2 = Dispatch(List=crv_4, DispatchPattern=larger_2.LargerThan)  # -> ListA, ListB
flip = FlipCurve(Curve=dispatch_2.ListA)  # -> Curve, Flag
merge_3 = Merge(Data1=flip.Curve, Data2=dispatch_2.ListB)
end_4 = EndPoints(Curve=merge_3)  # -> Start, End
ln = Line(StartPoint=end_3.End, EndPoint=end_4.End)
ln_2 = Line(StartPoint=end_3.Start, EndPoint=end_4.Start)
merge_4 = Merge(Data1=crv_3, Data2=ln_2, Data3=crv_4, Data4=ln)
join_3 = JoinCurves(Curves=merge_4, Preserve=False)
boundary = BoundarySurfaces(Edges=join_3)

explode_4 = Explode(Curve=pshift_6, Recursive=True)  # -> Segments, Vertices

crv_5 = Curve(pshift_5)
division_3 = Division(A=number_slider_4, B=Slider(4, range=0..10))
neg_2 = Negative(Value=division_3)
offset = OffsetCurve(Curve=crv_5, Distance=neg_2, Corners=1)
offset_2 = OffsetCurve(Curve=crv_5, Distance=division_3, Corners=1)
end_5 = EndPoints(Curve=offset)  # -> Start, End
end_6 = EndPoints(Curve=offset_2)  # -> Start, End
ln_3 = Line(StartPoint=end_6.End, EndPoint=end_5.End)
ln_4 = Line(StartPoint=end_6.Start, EndPoint=end_5.Start)
merge_5 = Merge(Data1=offset_2, Data2=ln_4, Data3=offset, Data4=ln_3)
join_4 = JoinCurves(Curves=merge_5, Preserve=False)
Z_3 = UnitZ(Factor=number_slider_4)
subtraction = Subtraction(A=graft, B=number_slider_4)
extr = Extrude(Base=join_4, Direction=Z_3)
Z_4 = UnitZ(Factor=subtraction)
cap = CapHoles(Brep=extr)
pshift_8 = ShiftPaths(Data=cap, Offset=-2)
move_3 = Move(Geometry=pshift_8, Motion=Z_4)  # -> Geometry, Transform

crv_6 = Curve(pshift_5)
explode_5 = Explode(Curve=crv_6, Recursive=True)  # -> Segments, Vertices
end_7 = EndPoints(Curve=explode_5.Segments)  # -> Start, End
vec2pt = Vector2Pt(PointA=end_7.Start, PointB=end_7.End, Unitize=False)  # -> Vector, Length
neg_3 = Negative(Value=vec2pt.Vector)
division_4 = Division(A=number_slider_5, B="4")
line = LineSDL(Start=end_7.Start, Direction=vec2pt.Vector, Length=number_slider_5)
line_2 = LineSDL(Start=end_7.End, Direction=neg_3, Length=number_slider_5)
join_5 = JoinCurves(Curves=[line, line_2], Preserve=False)  # -> graft(Curves)
xy_2 = XYPlane(Origin=Point(0, 0, 0))
neg_4 = Negative(Value=division_4)
offset_3 = OffsetCurve(Curve=join_5, Distance=division_4, Plane=xy_2, Corners=1)
offset_4 = OffsetCurve(Curve=join_5, Distance=neg_4, Plane=xy_2, Corners=1)
end_8 = EndPoints(Curve=offset_4)  # -> Start, End
len_2 = Length(Curve=offset_3)
end_9 = EndPoints(Curve=offset_3)  # -> Start, End
len_3 = Length(Curve=offset_4)
larger_3 = LargerThan(FirstNumber=len_2, SecondNumber=expr("x*5", number_slider_5))  # -> LargerThan, OrEqualTo
larger_4 = LargerThan(FirstNumber=len_3, SecondNumber=expr("x*5", number_slider_5))  # -> LargerThan, OrEqualTo
ln_5 = Line(StartPoint=end_9.Start, EndPoint=end_8.Start)
ln_6 = Line(StartPoint=end_9.End, EndPoint=end_8.End)
merge_6 = Merge(Data1=offset_3, Data2=ln_5, Data3=offset_4, Data4=ln_6)
or = GateOr(A=larger_3.LargerThan, B=larger_4.LargerThan)
not = GateNot(A=or)
join_6 = JoinCurves(Curves=merge_6, Preserve=False)
cull_2 = CullPattern(List=join_6, CullPattern=not)
pshift_9 = ShiftPaths(Data=cull_2, Offset=-5)

merge_7 = Merge(Data1=pline, Data2=pline_2)
boundary_2 = BoundarySurfaces(Edges=merge_7)
move_4 = Move(Geometry=boundary_2, Motion=Z_2)  # -> Geometry, Transform

flatten_tree = FlattenTree(Tree=boundary, Path="{0}")
area = Area(Geometry=flatten_tree)  # -> Area, Centroid
deconstruct = Deconstruct(Point=area.Centroid)  # -> XComponent, YComponent, ZComponent
sort_list = SortList(Keys=deconstruct.ZComponent, ValuesValuesA=flatten_tree)  # -> Keys, ValuesValuesA

# ---- group: horizontal mullion
merge_8 = Merge(Data1=pshift_8, Data2=move_3.Geometry)

# ----
list_item = ListItem(List=reverse(sort_list.ValuesValuesA), Index=0, Wrap=True)
move_5 = Move(Geometry=list_item, Motion=unit_z)  # -> Geometry, Transform

# ---- group: vertical mullion
extr_2 = Extrude(Base=pshift_9, Direction=Z_2)

# ---- group: glass
extr_3 = Extrude(Base=explode_4.Segments, Direction=Z_2)

# ---- group: top and bottom caps
merge_9 = Merge(Data1=boundary_2, Data2=move_4.Geometry, Data3=boundary, Data4=move_5.Geometry)

# ----
python_3_script = Python3Script(panels=flatten(extr_3), frames=flatten([merge_9, extr_2, merge_8]), to_mm=Slider(1000, range=0..1000))  # -> out, a, info; inputs panels: list of Brep, frames: list of Brep, to_mm: Double
# ---------- python_3_script: Python ----------
"""
Inputs:
    panels: Brep, List Access  - one item per glass pane
    frames: Brep, List Access  - frame geometry, passed through without panel data
    to_mm:  float, Item Access - model units to mm (1 if the model is in mm, 1000 if in metres)
Outputs:
    a:    meshes for Context Bake
    info: one line per panel, for checking in a Panel component
"""
import Rhino.Geometry as rg


def mesh_of(brep):
    """Turns a Brep into a single mesh."""
    mesh = rg.Mesh()
    for part in rg.Mesh.CreateFromBrep(brep, rg.MeshingParameters.FastRenderMesh) or []:
        mesh.Append(part)
    return mesh


def size_of(brep):
    """Width (horizontal) and height (vertical) of a pane, measured in the pane's own plane."""
    face = brep.Faces[0]
    ok, face_frame = face.FrameAt(face.Domain(0).Mid, face.Domain(1).Mid)
    normal = face_frame.ZAxis

    across = rg.Vector3d.CrossProduct(rg.Vector3d.ZAxis, normal)  # horizontal, along the pane
    if across.IsTiny():  # pane lies flat, like a roof: fall back to the surface's own direction
        across = face_frame.XAxis
    across.Unitize()
    up = rg.Vector3d.CrossProduct(normal, across)
    up.Unitize()

    box = brep.GetBoundingBox(rg.Plane(face_frame.Origin, across, up))  # box measured in that plane
    return box.Max.X - box.Min.X, box.Max.Y - box.Min.Y


scale = to_mm if to_mm else 1.0
a = []
info = []

for i, brep in enumerate(panels or []):
    if brep is None:
        continue
    width, height = size_of(brep)
    width_mm, height_mm = round(width * scale), round(height * scale)
    area_m2 = (width_mm / 1000.0) * (height_mm / 1000.0)
    mass_kg = area_m2 * (4 / 1000.0) * 2500 * 2

    mesh = mesh_of(brep)
    mesh.SetUserString("part", "panel")
    mesh.SetUserString("panel_id", str(i))
    mesh.SetUserString("material", "glass")
    mesh.SetUserString("width", str(width_mm))
    mesh.SetUserString("height", str(height_mm))
    mesh.SetUserString("mass", str(round(mass_kg, 1)))
    a.append(mesh)
    info.append("panel {}: {} x {} mm ({} faces)".format(i, width_mm, height_mm, brep.Faces.Count))

for brep in frames or []:
    if brep is None:
        continue
    mesh = mesh_of(brep)
    mesh.SetUserString("part", "frame")
    mesh.SetUserString("material", "frame")
    a.append(mesh)
# ---------- end python_3_script ----------
context_bake = ContextBake(Content=python_3_script.a)
